# Grasshopper definition voronoi_corridor.gh (Grasshopper 1.0.8)

brep = Brep(<brep referenced from the Rhino model>)
area = Area(Geometry=brep)  # -> Area, Centroid
popgeo = PopulateGeometry(Geometry=brep, Count=50, Seed=2)
scale = Scale(Geometry=brep, Center=area.Centroid, Factor=2)  # -> Geometry, Transform
popgeo_2 = PopulateGeometry(Geometry=brep, Count=50, Seed=1)
voronoi³ = Voronoi3D(Points=popgeo, Box=scale.Geometry)  # -> Cells, Boundary
voronoi³_2 = Voronoi3D(Points=popgeo_2, Box=scale.Geometry)  # -> Cells, Boundary
volume = Volume(Geometry=voronoi³_2.Cells)  # -> Volume, Centroid
scale_2 = Scale(Geometry=voronoi³_2.Cells, Center=volume.Centroid, Factor=0.8)  # -> Geometry, Transform
trim = TrimSolid(Shape=brep, Cutters=scale_2.Geometry)
item = ListItem(List=trim, Index=0, Wrap=True)
splitmul = SplitBrepMultiple(Brep=item, Cutters=voronoi³.Cells)
Z = UnitZ(Factor=Slider(-48.45, range=-100..0))
extr = Extrude(Base=splitmul, Direction=Z)
